# Grasshopper definition girder_system.gh (Grasshopper 1.0.7)
# plug-ins: gh_sofistik

segments = Slider(11, range=1..50)
half_width = Slider(3, range=1..5)
length = Slider(63.2, range=10..200)
radius = Slider(147.2, range=10..1000)
cluster_main_arc = ClusterMainArc(x=radius, R=radius, A=length, B=radius)
neg = Negative(Value=half_width)
girder_right = OffsetCurve(Curve=cluster_main_arc, Distance=half_width, Plane=PlaneXY(0, 0, 0), Corners=1)
girder_left = OffsetCurve(Curve=cluster_main_arc, Distance=neg, Plane=PlaneXY(0, 0, 0), Corners=1)
divide = DivideCurve(Curve=girder_left, Count=segments, Kinks=False)  # -> Points, Tangents, Parameters
divide_2 = DivideCurve(Curve=girder_right, Count=segments, Kinks=False)  # -> Points, Tangents, Parameters
end = EndPoints(Curve=[girder_right, girder_left])  # -> Start, End
cross_girders = Line(StartPoint=divide_2.Points, EndPoint=divide.Points)
sln_main_girders = SLN(Curve=[girder_right, girder_left], NumberS=0, Group=0, Section=1, LocalZ=Vector(0, 0, 0))
sln_cross_girders = SLN(Curve=cross_girders, NumberS=0, Group=0, Section=2, LocalZ=Vector(0, 0, 0))
spt_supports = SPT(Point=[end.Start, end.End], NumberS=0, LocalX=Vector(0, 0, 0), LocalZ=Vector(0, 0, 0), Fixation="PP")
panel = Panel("""PROG AQUA
HEAD
NORM DIN EN1992-2004
CONC 1 C 30
SREC 1 H 1000 200
SREC 2 H 500 200
END""")
sofimshc = SOFiMSHC(IntersectionTolerance=0.01, CreateMesh=True, MeshDensity=1, Geometry=[sln_cross_girders, sln_main_girders, spt_supports])
merge = Merge(Data1=panel, Data2=sofimshc)
panel_2 = Panel(merge)

# ==== cluster ClusterMainArc
x = ClusterInput()
neg = Negative(Value=x)
pt = ConstructPoint(XCoordinate=0, YCoordinate=neg, ZCoordinate=0)
A = ClusterInput()
B = ClusterInput()
division = Division(A=A, B=B)
pl = ConstructPlane(Origin=pt, XAxis=Vector(0, 9.746899704, 0), YAxis=Vector(13.4668567, 0, 0))
R = ClusterInput()
arc = Arc(Plane=pl, Radius=R, Angle=division)  # -> Arc, Length
A_2 = ClusterOutput(arc.Arc)
